# Grasshopper definition SOM_Isovist.gh (Grasshopper 1.0.8)

startpoint = Point(Point(0, 0, 0))
boundarycontext = Curve([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])

pt = Point(Point(91.43146833, 4.07189317, 0))
vec = Vector(Vector(1.197631037, 1.44872484, 0))
trigger = Trigger(Interval=20, TimerInterval=20, Target=c_script)  # disabled
trigger_2 = Trigger(Interval=10, TimerInterval=10, Target=c_script_2)  # disabled

# ---- group: MainRoom
main_room = Point([Point(-51, -305, 0), Point(-239, -2878, 0), Point(-666, -4723, 0), Point(-2536, -4911, 0), Point(-4482, -4974, 0), Point(-5912, -4673, 0), Point(-6113, -2878, 0), Point(-5737, -1623, 0), Point(-3051, -644, 0)])

# ----
c_script = CSharpScript(
    point=startpoint,
    vec=vec,
    detail=Slider(30, range=0..100),
    range=Slider(170, range=0..1000),
    curve=boundarycontext,
    reset=Button())  # -> out, A, B, D; inputs point: Point3d, vec: Vector3d, detail: Int32, range: Double, curve: list of Curve, reset: Boolean
# ---------- c_script: C# ----------
// Grasshopper Script Instance
#region Usings
using System;
using System.Linq;
using System.Collections;
using System.Collections.Generic;
using System.Drawing;

using Rhino;
using Rhino.Geometry;

using Grasshopper;
using Grasshopper.Kernel;
using Grasshopper.Kernel.Data;
using Grasshopper.Kernel.Types;
#endregion

public class Script_Instance : GH_ScriptInstance
{
    private void RunScript(
		Point3d point,
		Vector3d vec,
		int detail,
		double range,
		List<Curve> curve,
		bool reset,
		ref object A,
		ref object B,
		ref object D)
    {
        if (reset || isoAgent == null)
        {
            isoAgent = new IsoAgent(detail, range, point, vec);
        }

        isoAgent.Observe(curve);
        isoAgent.Update();


        D = isoAgent.data;
        B = isoAgent.pos;
        A = isoAgent.drawTrail();
    }

    public static Point3d ClosestPoint(List<Point3d> C, Point3d P)
    {
        var pc = new PointCloud(C);
        var index = pc.ClosestPoint(P);
        if (index != -1)
        {
            return C[index];
        }
        else
        {
            return Point3d.Unset;
        }
    }

    public static List<Vector3d> Isovist(int num, double angle, Vector3d direction)
    {
        var a = Vector3d.VectorAngle(Vector3d.YAxis, direction);
        if(direction.X > 0)
        a = 2 * Math.PI - a;

        var vectors = new List<Vector3d>();

        double phase = (Math.PI - angle) / 2;
        for (int i = 0; i < num; i++)
        {
            var x = Math.Cos(i * (1.0 / (num - 1)) * angle + phase + a);
            var y = Math.Sin(i * (1.0 / (num - 1)) * angle + phase + a);
            vectors.Add(new Vector3d(x,y,0));
        }
        return vectors;
    }

    IsoAgent isoAgent;

    public class IsoAgent
    {
        int detail;
        double range;
        public Point3d pos;
        public Vector3d dir, iso;
        public List<object> data = new List<object>();
        private List<Point3d> trail = new List<Point3d>();
        
        public IsoAgent(int detail, double range, Point3d pos, Vector3d dir)
        {
            this.detail = detail;
            this.range = range;
            this.pos = pos;
            this.dir = dir;
            dir.Unitize();

            trail.Add(pos);
        }

        public Curve drawTrail()
        {
            if(trail.Count >= 2)
            return Curve.CreateInterpolatedCurve(trail,3);
            else return null;
        }

        public void Update() //Changing Here
        {
            dir += iso * 0.6f;
            pos += dir * 30;

            trail.Add(pos);
        }

        public void Observe(List<Curve> context)
        {
            data = new List<object>();
            var isovist = Isovist(detail, (range/180) * Math.PI, dir);

            var rays = new List<Line>();
            var hits = new List<Point3d>();

            for (int i = 0; i < isovist.Count; i++)
            {
                var ray = new Line(pos, isovist[i], 3200); //Changing Here
                rays.Add(ray);
                data.Add((object)ray);
                 
                var contextIntersections = new List<Point3d>();

                for (int j = 0; j < context.Count; j++)
                {
                    var events = Rhino.Geometry.Intersect.Intersection.CurveCurve(context[j],ray.ToNurbsCurve(),0.1,0.1);

                    if(events != null)
                    {
                        var points = new List<Point3d>();
                        for (int k = 0; k < events.Count; k++)
                        {
                            points.Add(events[k].PointA);
                        }
                        var closest = ClosestPoint(points, pos);
                        contextIntersections.Add(closest);
                    }
                }

                var singleClosest = ClosestPoint(contextIntersections, pos);
                hits.Add(singleClosest);
            }

            var distances = hits.Select(x => x.DistanceTo(pos)).ToList();

            double max = double.MinValue;
            Point3d longest = Point3d.Unset;
            iso = Vector3d.Unset;

            for (int j = 0; j < distances.Count; j++)
            {
                if(distances[j] > max)
                {
                    max = distances[j];
                    longest = hits[j];
                    iso = isovist[j];
                }
            }

            data.Add(longest);

            iso.Unitize();
            iso = iso - dir;
        }
    }
}
# ---------- end c_script ----------
c_script_2 = CSharpScript(reset=Button(), points=main_room)  # -> out, a, b; inputs reset: Boolean, points: list of Point3d
# ---------- c_script_2: C# ----------
#region Usings
using System;
using System.Linq;
using System.Collections;
using System.Collections.Generic;
using System.Drawing;

using Rhino;
using Rhino.Geometry;

using Grasshopper;
using Grasshopper.Kernel;
using Grasshopper.Kernel.Data;
using Grasshopper.Kernel.Types;
#endregion

public class Script_Instance : GH_ScriptInstance
{ 
    private void RunScript(
		bool reset,
		List<Point3d> points,
		ref object a,
		ref object b)
    {
        if(init == true || reset == true)
        {
            numNodes = points.Count() * 2;
            inputs = points.Select(point => new Input(point)).ToArray();
            som = new SOM(numWeights, 1.5);
            iter = 1;

            houses.Clear();
            displayInputs();
            init = false;
            reset = false;
        }
        som.trainNodes(inputs);
        iter++;
        path.Clear();
        som.displayNodes();

        a = houses;
        b = path;
    }

    public static bool init = true;
    public static Random rnd = new Random();

    public static double width = 1000;
    public static double height = 1000;
    public static double rectangleSize = 0.025;

    public static int iter;
    public static long maxIters = 500;

    public static int numWeights = 2;
    public static int numNodes;

    public static List<Rectangle3d> houses = new List<Rectangle3d>();
    public static List<Polyline> path = new List<Polyline>();

    public static Input[] inputs;

    public static SOM som;

    public static void displayInputs()
    {
        for (int i = 0; i < inputs.Length; i++)
        {
            inputs[i].draw();
        }
    }

    public class Input
    {
        public double[] w;
        public Plane pl;

        public Input(Point3d point)
        {
            w = new double[3];
            w[0] = point.X;
            w[1] = point.Y;
            w[2] = point.Z;
            pl = new Plane(point, new Vector3d(0,0,1));
        }

        public void draw()
        {
            var rect = new Rectangle3d(Plane.WorldXY,
            new Interval(w[0] - rectangleSize / 2, w[0] + rectangleSize / 2),
            new Interval(w[1] - rectangleSize / 2, w[1] + rectangleSize / 2));

            houses.Add(rect);
        }
    }

    public class Node
    {
        public double[] w;

        public Node(int num)
        {
            w = new double[num];
            for (int i = 0; i < num; i++)
            {
                w[i] = rnd.NextDouble();
            }
        }
    }

    public class SOM
    {
        public Node[] nodes;
        public double radius, learning, timeConstant, radiusDecay, learningDecay;

        public SOM(int num, double learn)
        {
            radius = numNodes / 2;
            learning = learn;

            nodes = new Node[numNodes];
            for (int i = 0; i < numNodes; i++)
            {
                nodes[i] = new Node(num);
            }

            timeConstant = maxIters/ Math.Log(radius);
        }

        public int BMU(Input inpt)
        {
            int win = -1;
            double minDist = width + height;

            for (int i = 0; i < nodes.Length; i++)
            {
                double d = distance(nodes[i].w, inpt.w);
                if(d < minDist)
                {
                    minDist = d;
                    win = i;
                }
            }
            return win;
        }

        public double distance(double[] a, double[] b)
        {
            double dist = 0.0;
            int numWeightsToCompare = Math.Min(a.Length, b.Length);

            for (int i = 0; i < a.Length; i++)
            {
                dist += Math.Pow(a[i] - b[i], 2);
            }

            dist = Math.Sqrt(dist);
            return dist;
        }

        public void updateNodeWeights(Input inpt, int winner)
        {
            for (int i = 0; i < nodes.Length; i++)
            {
                for (int j= 0; j < numWeights; j++)
                {
                    nodes[i].w[j] += learningDecay * BMUInfluence(winner, i) * (inpt.w[j] - nodes[i].w[j]);
                }
            }
        }

        public double BMUInfluence(int win, int index)
        {
            double delta1 = Math.Abs(index - win);
            double delta2 = numNodes - delta1;

            double delta = Math.Min(delta1, delta2);

            double f = Math.Exp((-1 * Math.Pow(delta, 2) / (2 * Math.Pow(radiusDecay, 2))));
            return f;
        }

        public void trainNodes(Input[] inpt)
        {
            learningDecay = learning * Math.Exp(-1 * iter / timeConstant);
            radiusDecay = radius * Math.Exp(-1 * iter / timeConstant);

            for (int i = 0; i < inpt.Length; i++)
            {
                int won = BMU(inpt[i]);
                updateNodeWeights(inpt[i], won);
            }
        }

        public void displayNodes()
        {
            var pts = new List<Point3d>();
            for (int i = 0; i < numNodes; i++)
            {
                pts.Add(new Point3d(nodes[i].w[0], nodes[i].w[1], 0));
            }
            pts.Add(new Point3d(nodes[0].w[0], nodes[0].w[1], 0));

            var pln = new Polyline(pts);
            path.Add(pln);
        }
    }
}
# ---------- end c_script_2 ----------
panel = Panel(c_script.A)
curve = Curve(c_script.A)
panel_2 = Panel(c_script_2.a)
curve_2 = Curve(c_script_2.b)
